# Dynamo graph MechanicalRoom_Automation_v1.dyn (Dynamo 3.7.0.11777)

string = StringInput("C:\BIM AUTOMOTATION\BIM automation.xlsx")
string_2 = StringInput("Equipment Schedule")
categories = Categories("OST_MechanicalEquipment")
all_elements_of_category = ElementsOfCategory(Category=categories)
string_3 = StringInput("Equipment ID")
getParameterValueByName = Element.GetParameterValueByName(element=all_elements_of_category, parameterName=string_3)
string_4 = StringInput("Equipment Type")
getParameterValueByName_2 = Element.GetParameterValueByName(element=all_elements_of_category, parameterName=string_4)
string_5 = StringInput("Flow Rate")
getParameterValueByName_3 = Element.GetParameterValueByName(element=all_elements_of_category, parameterName=string_5)
string_6 = StringInput("Head")
getParameterValueByName_4 = Element.GetParameterValueByName(element=all_elements_of_category, parameterName=string_6)
list_create = List.Create(item0=getParameterValueByName, item1=getParameterValueByName_2, item2=getParameterValueByName_3, item3=getParameterValueByName_4)
transpose = List.Transpose(lists=list_create)
boolean = BoolSelector(true)
openXMLExportExcel = Data.OpenXMLExportExcel(filePath=string, sheetName=string_2, data=transpose, overWrite=boolean)
